# Grasshopper definition GHLoftingRects.gh (Grasshopper 1.0.8)

# ---- group: Top Rect
unit_z = UnitZ(Factor=Slider(37, range=0..100))
xy_plane = XYPlane(Origin=unit_z)
rectangle = Rectangle(Plane=xy_plane, XSize=Slider(7, range=0..100), YSize=Slider(51, range=0..100), Radius=Slider(0, range=0..100))  # -> Rectangle, Length

# ---- group: Middle Rect
number_slider = Slider(2, range=0..20)
unit_z_2 = UnitZ(Factor=Slider(9, range=0..20))
xy_plane_2 = XYPlane(Origin=unit_z_2)
rectangle_2 = Rectangle(Plane=xy_plane_2, XSize=Slider(52, range=0..100), YSize=Slider(60, range=0..100), Radius=Slider(7, range=0..100))  # -> Rectangle, Length

# ---- group: Bottom Rect
xy_plane_3 = XYPlane(Origin=Point(0, 0, 0))
rectangle_3 = Rectangle(Plane=xy_plane_3, XSize=Slider(72, range=0..100), YSize=Slider(72, range=0..100), Radius=Slider(0, range=0..100))  # -> Rectangle, Length

# ----
merge = Merge(Data1=rectangle.Rectangle, Data2=rectangle_2.Rectangle, Data3=rectangle_3.Rectangle)

# ---- group: Loft Geometry
geometry = Geometry([rectangle.Rectangle, rectangle_2.Rectangle, rectangle_3.Rectangle])
loft = Loft(Curves=merge, Options={Adjust=False, Closed=False, LoftEnds=0, LoftSimp=0, LoftType=0, Rebuild=10, Refit=0.01})

# ----
panel = Panel(merge)
cap_holes = CapHoles(Brep=loft)
