# Grasshopper definition SimulateBallDropFloor.gh (Grasshopper 1.0.7)
# plug-ins: Kangaroo2 Components, Pancake

startz = Slider(30, range=0..30)
starty = Slider(0, range=0..30)
startx = Slider(0, range=0..30)
vector_xyz = VectorXYZ(XComponent=startx, YComponent=starty, ZComponent=startz)  # -> Vector, Length
sphere = Sphere(Base=PlaneXY(0, 0, 0), Radius=Slider(3, range=0..50))
move = Move(Geometry=sphere, Motion=vector_xyz.Vector)  # -> Geometry, Transform

# ---- group: Discretize BREP as Mesh
mesh_brep = MeshBrep(
    Brep=move.Geometry,
    Settings={GridMaxCount=0, GridMinCount=16, JaggedSeams=False, MaxEdgeLength=0, MinEdgeLength=0.0001, MinTolerance=0, Refine=True, RefineAngle=0, RelativeTolerance=0.65, SimplePlanes=True, Tolerance=0})

# ---- group: Floor
floor = Floor(Strength=Slider(1000, range=0..1000))

# ---- group: Gravity
# Simulation Goals
number_slider = Slider(-0.1, range=-9.8..0)
vertexloads = VertexLoads(Mesh=mesh_brep, Strength=number_slider)

# ----
entwine = Entwine(Branch00=vertexloads, Branch01=floor, FlattenInputs=True)
true_only_button = TrueOnlyButton(LastSaveLocalization="neutral,N")
stepsolver = StepSolver(
    GoalObjects=entwine,
    Tolerance=0.0001,
    Momentum=False,
    Damping=0.99,
    SubIterations=Slider(0, range=0..1000),
    Animate=Toggle(False))  # -> I, V, O
solver = Solver(GoalObjects=entwine, Reset=true_only_button, Threshold=1e-15, Tolerance=0.0001, On=Toggle(True))  # -> I, V, O
